# Grasshopper definition DDU_CSC_GrasshopperInterface_Example_07.gh (Grasshopper 1.0.8)

# ---- group: __DDU_CSC_EXAMPLE_07__
# Step 1.1
# comments & notes: Here we convert a lat/lon string to a location vector. You can get lat/lon from Google Maps (or similar services).
# 
# If you're at DDU, just leave it as it is. The pre-set value is the location of the DDU lab.
latitude_longitude_string_i_e_from_googl = Panel("49.861444, 8.676556")  # "Latitude/Longitude String (i.e. from Google Maps)"
convertgeolocation = ConvertGeoLocation(LatLonString=latitude_longitude_string_i_e_from_googl)  # -> Lat, Lon, Vec; inputs LatLonString: String
# ---------- convertgeolocation: Python ----------
#! python3
# -*- coding: utf-8 -*-
# venv: DDU_CSC
print('ENV OK!')
# r: charset_normalizer
# r: requests

# RHINO AND GH RELATED IMPORTS ------------------------------------------------
import System  # NOQA
import Grasshopper  # NOQA
import Rhino  # NOQA
import scriptcontext as sc  # NOQA

# GHENV COMPONENT SETTINGS ----------------------------------------------------
ghenv.Component.Name = 'ConvertGeoLocation'  # NOQA
ghenv.Component.NickName = 'ConvertGeoLocation'  # NOQA
ghenv.Component.Category = 'DDU_CSC'  # NOQA
ghenv.Component.SubCategory = '6 Data Tools'  # NOQA
ghenv.Component.Description = (  # NOQA
    'Converts a latitude, longitude string (i.e. from Google Maps) '
    'to its individual components. Example input: "12.1231321, 9.1231231312" '
    'Returns the location as individual numbers and as vector.'
)


class CSC_ConvertGeoLocation(Grasshopper.Kernel.GH_ScriptInstance):
    """
    Author: Max Benjamin Eschenbach
    License: MIT License
    Version: 260609
    """

    def __init__(self):
        """Initialize this component and set component parameters."""
        super().__init__()
        # initialize props
        self.Component = ghenv.Component  # NOQA
        self.InputParams = self.Component.Params.Input
        self.OutputParams = self.Component.Params.Output

    def _addRemark(self, msg: str = ''):
        """Add a remark message to the component."""
        rml = self.Component.RuntimeMessageLevel.Remark
        self.AddRuntimeMessage(rml, msg)

    def _addWarning(self, msg: str = ''):
        """Add a warning message to the component."""
        rml = self.Component.RuntimeMessageLevel.Warning
        self.AddRuntimeMessage(rml, msg)

    def _addError(self, msg: str = ''):
        """Add an error message to the component."""
        rml = self.Component.RuntimeMessageLevel.Error
        self.AddRuntimeMessage(rml, msg)

    def BeforeRunScript(self):
        """Perform some setup actions."""
        # Initialize input param descriptions
        self.InputParams[0].Description = (
            'Latitude, Longitude string, e.g. "12.1231321, 9.1231231312" '
        )
        # Initialize output param descriptions
        i = 0
        if self.OutputParams[0].Name == 'out':
            i += 1
        self.OutputParams[0+i].Description = (
            'Latitude component of the input string as float.'
        )
        self.OutputParams[1+i].Description = (
            'Longitude component of the input string as float.'
        )
        self.OutputParams[2+i].Description = (
            'Vector with lat/lon as X/Y.'
        )

    def RunScript(self, LatLonString: str):
        Lat = Grasshopper.DataTree[object]()
        Lon = Grasshopper.DataTree[object]()
        Vec = Grasshopper.DataTree[object]()
        _Results = [Lat, Lon, Vec]
        if not LatLonString:
            msg = 'Parameter LatLonString failed to collect data!'
            self._addWarning(msg)
            return _Results
        parts = LatLonString.split(',')
        if len(parts) > 2:
            msg = f'Splitting of Lat/Lon string failed! Raw result is {parts}...'
            self._addError(msg)
            return _Results
        Lat = float(parts[0].strip())
        Lon = float(parts[1].strip())
        Vec = Rhino.Geometry.Vector3d(Lat, Lon, 0)
        _Results = [Lat, Lon, Vec]
        return _Results
# ---------- end convertgeolocation ----------
location = Data(convertgeolocation.Vec)

# __DEVELOPMENT_CREDITS__: Authors: Max Benjamin Eschenbach
# Constributors: Alessandro Garruto
# 
# Digital Design Unit (DDU)
# Prof. Dr.-Ing. Oliver Tessmann
# Fachbereich Architektur
# Technical University of Darmstadt
# 
# CREDITS:
# ------------
# Please see: https://ddu.uber.space/credits
# Example 07:
# - Creating a new, (derived) component identity in the catalog
# Step 1
# comments & notes: Here we fetch a Transmitted ID from a QR Code Scan.
# 
# Use https://ddu.uber.space/transmit-id on your smartphone to scan a QR code and transmit the ID!
fetchtransmittedid = FetchTransmittedID()  # -> ComponentID
# ---------- fetchtransmittedid: Python ----------
#! python3
# -*- coding: utf-8 -*-
# venv: DDU_CSC
print('ENV OK!')
# r: charset_normalizer
# r: requests

# PYTHON STANDARD LIBRARY IMPORTS ---------------------------------------------
import json  # NOQA

# THIRD PARTY LIBRARY IMPORTS -------------------------------------------------
import requests  # NOQA

# RHINO AND GH RELATED IMPORTS ------------------------------------------------
import System  # NOQA
import Grasshopper  # NOQA
import Rhino  # NOQA
import scriptcontext as sc  # NOQA

# GHENV COMPONENT SETTINGS ----------------------------------------------------
ghenv.Component.Name = 'FetchTransmittedID'  # NOQA
ghenv.Component.NickName = 'FetchTransmittedID'  # NOQA
ghenv.Component.Category = 'DDU_CSC'  # NOQA
ghenv.Component.SubCategory = '2 Catalog Interface'  # NOQA
ghenv.Component.Description = (  # NOQA
    'Fetches the currently pending transmitted component ID for the signed-in '
    'user from the Catalog backend. Uses the existing CSC_Session '
    'authentication state.'
)


class CSC_FetchTransmittedID(Grasshopper.Kernel.GH_ScriptInstance):
    """
    Author: Max Benjamin Eschenbach
    License: MIT License
    Version: 260609
    """

    def __init__(self):
        """Initialize this component and set component parameters."""
        super().__init__()
        # initialize props
        self.Component = ghenv.Component  # NOQA
        self.InputParams = self.Component.Params.Input
        self.OutputParams = self.Component.Params.Output

    def _addRemark(self, msg: str = ''):
        """Add a remark message to the component."""
        rml = self.Component.RuntimeMessageLevel.Remark
        self.AddRuntimeMessage(rml, msg)

    def _addWarning(self, msg: str = ''):
        """Add a warning message to the component."""
        rml = self.Component.RuntimeMessageLevel.Warning
        self.AddRuntimeMessage(rml, msg)

    def _addError(self, msg: str = ''):
        """Add an error message to the component."""
        rml = self.Component.RuntimeMessageLevel.Error
        self.AddRuntimeMessage(rml, msg)

    def BeforeRunScript(self):
        """Perform some setup actions."""
        # Initialize output param descriptions
        i = 0
        if self.OutputParams[0].Name == 'out':
            i += 1
        self.OutputParams[0+i].Description = (
            'The currently pending transmitted ComponentID. Empty if none is '
            'pending.'
        )

    def get_auth_core_from_sticky(self):
        """Get AuthCore instance from sticky storage."""
        auth_core = sc.sticky.get('CSC_AuthCore')
        if auth_core is None:
            msg = ('No authentication found. Please use CSC_Session component '
                   'first.')
            self._addError(msg)
            self.Component.Message = msg
            return None
        return auth_core

    def RunScript(self, Refresh):
        component_id = Grasshopper.DataTree[object]()

        # Get AuthCore instance from sticky storage
        auth_core = self.get_auth_core_from_sticky()
        if auth_core is None:
            return component_id

        # Check if authentication is valid
        if not auth_core.is_valid():
            msg = ('Authentication expired. Please use CSC_Session '
                   'component to refresh.')
            self._addError(msg)
            self.Component.Message = msg
            return component_id

        try:
            self.Component.Message = 'Fetching transmitted ID...'

            response = auth_core.authorized_get('/component_id_transmission')

            if response.status_code == 200:
                payload = response.json()
                pending = payload.get('pending')

                if pending and isinstance(pending, dict):
                    component_id = str(pending.get('identity_id', '') or '')
                    self.Component.Message = 'Pending transmitted ID found'
                    self._addRemark(
                        f'Fetched pending transmitted ID: {component_id}'
                    )
                else:
                    self.Component.Message = 'No transmitted ID pending'
                    self._addRemark(
                        'No pending transmitted component ID for this user.'
                    )

                return component_id

            elif response.status_code == 401:
                msg = 'Authentication failed. Please sign in again.'
                self._addError(msg)
                self.Component.Message = msg

            elif response.status_code == 403:
                msg = 'Access denied. Insufficient permissions.'
                self._addError(msg)
                self.Component.Message = msg

            elif response.status_code == 500:
                msg = 'Server error. Please try again later.'
                self._addWarning(msg)
                self.Component.Message = msg

            else:
                msg = (f'Request failed with status code: '
                       f'{response.status_code}')
                self._addError(msg)
                self.Component.Message = msg

        except requests.exceptions.ConnectionError as e:
            msg = 'Cannot connect to server. Please check your connection.'
            self._addError(msg + f'\nFull Error: {str(e)}')
            self.Component.Message = msg

        except requests.exceptions.Timeout as e:
            msg = 'Request timeout. Server may be slow.'
            self._addError(msg + f'\nFull Error: {str(e)}')
            self.Component.Message = msg

        except requests.exceptions.RequestException as e:
            msg = f'Request error: {str(e)}'
            self._addError(msg)
            self.Component.Message = msg

        except Exception as e:
            msg = f'Unexpected error: {str(e)}'
            self._addError(msg)
            self.Component.Message = msg

        return component_id
# ---------- end fetchtransmittedid ----------
componentid = Panel(fetchtransmittedid)

# ParentIdentity: IMPORTANT: Here goes the UUID of the parent component (the component that your new, cut to shape piece was made from!)
parentidentity = Panel("")

# Step 2
# comments & notes: Here we create a new component identity (locally).
# 
# Most of the fields are already pre-set for you.
# You need to adjust:
# - Name
# - Dataset
# - Color
# - Parent Identity ID if applicable(Important!)
component_name = Panel("Schoenes Neues Feld 01")
complexity = ValueList({"0 (simple)": 0, "1 (average)": 1, "2 (complex)": 2, "3 (very complex)": 3}, selected="2 (complex)")
clearlocalstorage = Button()
material = ValueList({"corian", "concrete", "timber", "aluminium", "steel"}, selected="concrete")
transmittedidentityid = Data(componentid)
type = ValueList({"panel", "beam", "column", "slab", "rubble", "brick", "pipe", "profile", "connector", "other"}, selected="rubble")
fragment = BooleanToggle(True)
assembly = BooleanToggle(False)
color = ColourSwatch(SwatchColor=RGB(189, 189, 189))
location_2 = Data(location)
geometry = Data()
createcomponentidentity = CreateComponentIdentity(
    ClearLocalStorage=clearlocalstorage,
    IdentityID=transmittedidentityid,
    Name=component_name,
    Type=type,
    Material=material,
    Dataset="demo",
    Complexity=complexity,
    Fragment=fragment,
    Assembly=assembly,
    Color=color,
    Location=location_2,
    Geometry=geometry,
    ParentIdentity=parentidentity)  # -> ComponentData; inputs ClearLocalStorage: Boolean, IdentityID: String, Name: String, Type: String, Material: String, Dataset: String, Complexity: Int32, Fragment: Boolean, Assembly: Boolean, Color: Color, Location: Vector3d, Geometry: list of GeometryBase, MarkerPoints: list of Point3d
# ---------- createcomponentidentity: Python ----------
#! python3
# -*- coding: utf-8 -*-
# venv: DDU_CSC
print('ENV OK!')
# r: charset_normalizer
# r: requests
# r: numpy
# r: scipy
# r: scikit-learn

# PYTHON STANDARD LIBRARY IMPORTS ---------------------------------------------
import json  # NOQA
import struct  # NOQA
import uuid  # NOQA
import os  # NOQA
import platform  # NOQA

# THIRD PARTY LIBRARY IMPORTS -------------------------------------------------
import numpy as np  # NOQA
from scipy.spatial import ConvexHull  # NOQA
from sklearn.decomposition import PCA  # NOQA

# RHINO AND GH RELATED IMPORTS ------------------------------------------------
import System  # NOQA
import Grasshopper  # NOQA
import Rhino  # NOQA
import scriptcontext as sc  # NOQA

# One PCA sample per this many mm² of triangle area (3D mesh path).
REFERENCE_FACE_AREA_MM2 = 100.0

# GHENV COMPONENT SETTINGS ----------------------------------------------------
ghenv.Component.Name = 'CreateComponentIdentity'  # NOQA
ghenv.Component.NickName = 'CreateComponentIdentity'  # NOQA
ghenv.Component.Category = 'DDU_CSC'  # NOQA
ghenv.Component.SubCategory = '3 Component Operations'  # NOQA
ghenv.Component.Description = (  # NOQA
    'Builds a POST /identities payload (CreateComponentRequest) from Rhino '
    'geometry. Computes PCA orientation, mesh reduction, stages binary PLY '
    'files under pending_identity_assets/{identity_id}/meshes/<i>/.'
)


class CSC_CreateComponentIdentity(Grasshopper.Kernel.GH_ScriptInstance):
    """
    Author: Max Benjamin Eschenbach
    License: MIT License
    Version: 260609
    """

    def __init__(self):
        """Initialize this component and set component parameters."""
        super().__init__()
        # initialize props
        self.Component = ghenv.Component  # NOQA
        self.InputParams = self.Component.Params.Input
        self.OutputParams = self.Component.Params.Output

    def _addRemark(self, msg: str = ''):
        """Add a remark message to the component."""
        rml = self.Component.RuntimeMessageLevel.Remark
        self.AddRuntimeMessage(rml, msg)

    def _addWarning(self, msg: str = ''):
        """Add a warning message to the component."""
        rml = self.Component.RuntimeMessageLevel.Warning
        self.AddRuntimeMessage(rml, msg)

    def _addError(self, msg: str = ''):
        """Add an error message to the component."""
        rml = self.Component.RuntimeMessageLevel.Error
        self.AddRuntimeMessage(rml, msg)

    def BeforeRunScript(self):
        """Perform some setup actions."""
        # Initialize input param descriptions
        self.InputParams[0].Description = (
            'If True, clears pending_identity_assets staging '
            '(does not affect Session API cache)'
        )
        self.InputParams[1].Description = (
            'Identity ID from physical tag (valid UUID)'
        )
        self.InputParams[2].Description = (
            'Component Name (e.g. My Beam 01)'
        )
        self.InputParams[3].Description = (
            'Component type (e.g., "panel", "rubble"). Must be one of '
            'the values exposed by the backend component type enum.'
        )
        self.InputParams[4].Description = (
            'Material type (e.g., "steel", "concrete", "wood")'
        )
        self.InputParams[5].Description = (
            'Dataset that this component belongs to '
            '(i.e. my_rubble_dataset)'
        )
        self.InputParams[6].Description = (
            'Complexity level '
            '(0=simple, 1=normal, 2=complex, 3=very complex)'
        )
        self.InputParams[7].Description = (
            'Fragment status (True for fragments, False for complete)'
        )
        self.InputParams[8].Description = (
            'Assembly status (True for assemblies, False for individual)'
        )
        self.InputParams[9].Description = (
            'Component color (System.Drawing.Color)'
        )
        self.InputParams[10].Description = (
            'Location as Vector3d (X=latitude, Y=longitude, Z ignored)'
        )
        self.InputParams[11].Description = (
            'Rhino geometry object(s) - single object or list of objects. '
            'For single: Mesh or Extrusion for panels, Mesh for rubble. '
            'For multiple: all must be Meshes.'
        )
        self.InputParams[12].Description = (
            'Marker points as list of Point3d objects for component '
            'identification and positioning'
        )
        self.InputParams[13].Description = (
            'Optional condition grade. Integer in {0, 1, 2, 3}: '
            '0=destroyed/retired, 1=poor, 2=average, 3=good. '
            'Leave unconnected for "unknown".'
        )
        self.InputParams[14].Description = (
            'Optional ISO-8601 UTC timestamp for when the component was '
            'originally manufactured (e.g. "1998-06-01T00:00:00Z").'
        )
        self.InputParams[15].Description = (
            'Optional precision qualifier for ManufacturedAt. One of '
            '"exact", "month", "year", "unknown".'
        )
        self.InputParams[16].Description = (
            'Optional short text describing where the component was '
            'salvaged from (e.g. building name, demolition site).'
        )
        self.InputParams[17].Description = (
            'Optional ISO-8601 UTC timestamp for when the component was '
            'salvaged (e.g. "2024-11-03T00:00:00Z").'
        )
        self.InputParams[18].Description = (
            'Optional parent identity UUID (lineage after split/merge)'
        )
        self.InputParams[19].Description = (
            'Optional free-text notes for the initial snapshot (max 5000)'
        )
        self.InputParams[20].Description = (
            'Count of identical physical items (integer >= 1, default 1)'
        )
        # Initialize output param descriptions
        i = 0
        if self.OutputParams[0].Name == 'out':
            i += 1
        self.OutputParams[0+i].Description = (
            'CreateComponentRequest JSON for POST /identities '
            '(SnapshotMesh vertices/faces/colors, extrusions[], PCA frames)'
        )

    def get_auth_core_from_sticky(self):
        """Get AuthCore instance from sticky storage."""
        auth_core = sc.sticky.get('CSC_AuthCore')
        if auth_core is None:
            self._addWarning(
                'No authentication found. Using hardcoded create schema.'
            )
            return None
        return auth_core

    def get_create_payload_schema(self):
        """Get CreateComponentRequest schema from Session cache or fallback."""
        auth_core = self.get_auth_core_from_sticky()
        if auth_core and hasattr(auth_core, 'get_create_identity_schema'):
            try:
                schema = auth_core.get_create_identity_schema()
                if schema:
                    self._addRemark('Using cached create-identity schema')
                    return schema
                self._addWarning(
                    'Failed to get cached create-identity schema; '
                    'using hardcoded fallback'
                )
            except Exception as e:
                self._addWarning(
                    f'Error fetching create-identity schema: {e}; '
                    'using hardcoded fallback'
                )

        self._addRemark('Using hardcoded create-identity schema')
        return self.get_hardcoded_create_schema()

    def get_hardcoded_create_schema(self):
        """
        Minimal CreateComponentRequest schema when Session is unavailable.
        """
        return {
            'type': 'object',
            'required': [
                'type', 'material', 'dataset', 'complexity', 'fragment',
                'assembly', 'geometry', 'bbx', 'bbx_origin', 'iframe',
                'pca_frame',
            ],
            'properties': {
                '_id': {'type': 'string'},
                'name': {'type': 'string'},
                'type': {'type': 'string'},
                'material': {'type': 'string'},
                'dataset': {'type': 'string'},
                'complexity': {'type': 'integer'},
                'fragment': {'type': 'boolean'},
                'assembly': {'type': 'boolean'},
                'geometry': {'type': 'object'},
                'color': {'type': 'array'},
                'bbx': {'type': 'array'},
                'bbx_origin': {'type': 'array'},
                'location': {'type': 'object'},
                'iframe': {'type': 'object'},
                'pca_frame': {'type': 'object'},
                'validated': {'type': 'boolean'},
                'marker_points': {'type': 'array'},
                'parent_identities': {'type': 'array'},
                'notes': {'type': 'string'},
                'quantity': {'type': 'integer'},
            },
        }

    def validate_create_payload(self, payload, schema):
        """Validate create payload against schema required fields."""
        try:
            required_fields = schema.get('required', [])
            missing_fields = [
                field for field in required_fields if field not in payload
            ]
            if missing_fields:
                self._addError(
                    f'Missing required fields: {", ".join(missing_fields)}'
                )
                return False

            if not isinstance(payload.get('complexity'), int):
                self._addError('complexity must be an integer')
                return False
            if not isinstance(payload.get('fragment'), bool):
                self._addError('fragment must be a boolean')
                return False
            if not isinstance(payload.get('assembly'), bool):
                self._addError('assembly must be a boolean')
                return False

            color = payload.get('color', [])
            if color and (not isinstance(color, list) or len(color) != 3):
                self._addError('color must be a list of 3 integers [R, G, B]')
                return False

            if not isinstance(payload.get('iframe'), dict):
                self._addError('iframe must be a frame object')
                return False
            if not isinstance(payload.get('pca_frame'), dict):
                self._addError('pca_frame must be a frame object')
                return False

            geometry = payload.get('geometry') or {}
            if not (
                geometry.get('meshes')
                or geometry.get('extrusions')
                or geometry.get('point_clouds')
            ):
                self._addError(
                    'geometry must include meshes, extrusions, or point_clouds'
                )
                return False

            return True

        except Exception as e:
            self._addError(f'Validation error: {str(e)}')
            return False

    def build_create_payload(
            self,
            identity_id: str,
            name: str,
            component_type: str,
            material: str,
            dataset: str,
            complexity: int,
            fragment: bool,
            assembly: bool,
            color,
            dimensions,
            location_data,
            principal_components,
            condition,
            manufactured_at,
            manufactured_precision,
            salvage_source,
            salvaged_at,
            parent_identity,
            notes,
            quantity):
        """Build POST /identities JSON body (CreateComponentRequest)."""
        payload = {
            '_id': identity_id,
            'type': component_type,
            'material': material,
            'dataset': dataset,
            'complexity': int(complexity),
            'fragment': bool(fragment),
            'assembly': bool(assembly),
            'geometry': {},
            'color': [color.R, color.G, color.B],
            'bbx': dimensions,
            'bbx_origin': [0.0, 0.0, 0.0],
            'location': location_data or {'lat': 0.0, 'lon': 0.0},
            'descriptors': {},
            'processes': {},
            'attributes': {},
            'iframe': {
                'o': [0.0, 0.0, 0.0],
                'x': [1.0, 0.0, 0.0],
                'y': [0.0, 1.0, 0.0],
                'z': [0.0, 0.0, 1.0],
            },
            'pca_frame': {
                'o': [0.0, 0.0, 0.0],
                'x': principal_components[0].tolist(),
                'y': principal_components[1].tolist(),
                'z': principal_components[2].tolist(),
            },
            'validated': False,
        }

        trimmed_name = (name or '').strip()
        if trimmed_name:
            payload['name'] = trimmed_name

        if condition is not None:
            payload['condition'] = condition
        if manufactured_at:
            payload['manufactured_at'] = manufactured_at
        if manufactured_precision:
            payload['manufactured_precision'] = manufactured_precision
        if salvage_source:
            payload['salvage_source'] = salvage_source
        if salvaged_at:
            payload['salvaged_at'] = salvaged_at
        if parent_identity:
            payload['parent_identities'] = [parent_identity]

        trimmed_notes = (notes or '').strip()
        if trimmed_notes:
            payload['notes'] = trimmed_notes[:5000]

        try:
            qty = int(quantity) if quantity is not None else 1
        except (TypeError, ValueError):
            qty = 1
        qty = max(1, min(999_999, qty))
        if qty != 1:
            payload['quantity'] = qty

        return payload

    def mesh_to_inline_primitive(self, mesh, default_rgb):
        """SnapshotMesh dict (vertices/faces/colors, Rhino Z-up)."""
        vertices = [[p.X, p.Y, p.Z] for p in mesh.Vertices]
        faces = []
        for face in mesh.Faces:
            if face.IsTriangle:
                faces.append([face.A, face.B, face.C])
            elif face.IsQuad:
                faces.append([face.A, face.B, face.C])
                faces.append([face.A, face.C, face.D])

        if mesh.VertexColors.Count > 0:
            colors = [
                [mesh.VertexColors[i].R, mesh.VertexColors[i].G,
                 mesh.VertexColors[i].B]
                for i in range(mesh.Vertices.Count)
            ]
        else:
            colors = [list(default_rgb)] * len(vertices)

        return {
            'vertices': vertices,
            'faces': faces,
            'colors': colors,
        }

    def save_rhino_mesh_as_ply_binary(self, mesh, file_path, default_rgb):
        """Write binary little-endian PLY (Rhino Z-up) with per-vertex RGB."""
        vertices = []
        colors = []
        has_vc = mesh.VertexColors.Count > 0
        for i in range(mesh.Vertices.Count):
            v = mesh.Vertices[i]
            vertices.append((v.X, v.Y, v.Z))
            if has_vc and i < mesh.VertexColors.Count:
                c = mesh.VertexColors[i]
                colors.append((c.R, c.G, c.B))
            else:
                colors.append(default_rgb)

        faces = []
        for face in mesh.Faces:
            if face.IsTriangle:
                faces.append((face.A, face.B, face.C))
            elif face.IsQuad:
                faces.append((face.A, face.B, face.C))
                faces.append((face.A, face.C, face.D))

        header = (
            'ply\n'
            'format binary_little_endian 1.0\n'
            f'element vertex {len(vertices)}\n'
            'property float x\n'
            'property float y\n'
            'property float z\n'
            'property uchar red\n'
            'property uchar green\n'
            'property uchar blue\n'
            f'element face {len(faces)}\n'
            'property list uchar int vertex_indices\n'
            'end_header\n'
        )

        os.makedirs(os.path.dirname(file_path), exist_ok=True)
        with open(file_path, 'wb') as handle:
            handle.write(header.encode('ascii'))
            for (x, y, z), (r, g, b) in zip(vertices, colors):
                handle.write(struct.pack('<fffBBB', x, y, z, r, g, b))
            for tri in faces:
                handle.write(struct.pack('<Biii', 3, tri[0], tri[1], tri[2]))

    def center_geometry_at_origin(self, geometry):
        """
        Center extrusion at its volume centroid.
        Returns centered geometry and translation vector.
        """
        # Get the volume centroid of the geometry
        vmp = Rhino.Geometry.VolumeMassProperties.Compute(geometry)
        volume_centroid = vmp.Centroid
        if volume_centroid is None:
            # Fallback to bounding box centroid if volume centroid fails
            bbox = geometry.GetBoundingBox(True)
            volume_centroid = bbox.Center
        # Create translation vector to center
        translation_vector = -np.array([
            volume_centroid.X, volume_centroid.Y, volume_centroid.Z
        ])
        # Create centered extrusion
        centered_geometry = geometry.Duplicate()
        translation_xform = Rhino.Geometry.Transform.Translation(
            translation_vector[0], translation_vector[1], translation_vector[2]
        )
        centered_geometry.Transform(translation_xform)
        return centered_geometry, translation_vector

    def _triangle_area(self, v0, v1, v2):
        return float(0.5 * np.linalg.norm(np.cross(v1 - v0, v2 - v0)))

    def sample_points_area_weighted_from_mesh(
            self,
            mesh,
            reference_face_area=REFERENCE_FACE_AREA_MM2,
            min_samples_per_face=1):
        """
        Build a PCA point cloud by repeating face centroids weighted by area.
        """
        vertices = np.array(
            [[v.X, v.Y, v.Z] for v in mesh.Vertices],
            dtype=np.float64,
        )
        if mesh.Faces.Count == 0:
            return vertices

        samples = []
        ref_area = max(reference_face_area, 1e-6)
        for face_idx in range(mesh.Faces.Count):
            face = mesh.Faces[face_idx]
            if face.IsTriangle:
                triangles = [[face.A, face.B, face.C]]
            elif face.IsQuad:
                triangles = [
                    [face.A, face.B, face.C],
                    [face.A, face.C, face.D],
                ]
            else:
                continue

            for tri in triangles:
                v0, v1, v2 = (
                    vertices[tri[0]], vertices[tri[1]], vertices[tri[2]]
                )
                area = self._triangle_area(v0, v1, v2)
                count = max(
                    min_samples_per_face,
                    int(round(area / ref_area)),
                )
                centroid = (v0 + v1 + v2) / 3.0
                samples.extend([centroid] * count)

        if not samples:
            return vertices
        return np.vstack(samples)

    def sample_points_for_pca_3d(self, geometry):
        """
        Collect area-weighted PCA samples from mesh or brep geometry.
        NOTE: CUrrently not used due to long runtime
        """
        if isinstance(geometry, Rhino.Geometry.Mesh):
            return self.sample_points_area_weighted_from_mesh(geometry)

        if isinstance(geometry, Rhino.Geometry.Brep):
            mp = Rhino.Geometry.MeshingParameters.Default
            brep_meshes = Rhino.Geometry.Mesh.CreateFromBrep(geometry, mp)
            if brep_meshes:
                chunks = [
                    self.sample_points_area_weighted_from_mesh(m)
                    for m in brep_meshes
                ]
                return np.vstack(chunks)

            return np.array(
                [[p.Location.X, p.Location.Y, p.Location.Z]
                 for p in geometry.Vertices],
                dtype=np.float64,
            )

        raise RuntimeError(
            'Area-weighted 3D sampling not implemented for geometry of type '
            f'{type(geometry)}!'
        )

    def compute_obb_3d(self, points):
        """
        Compute object oriented bounding box for 3D points using PCA.
        Returns unsorted dimensions and bounding box origin.
        """
        # Apply PCA to find principal axes
        pca = PCA(n_components=3)
        pca.fit(points)

        # Get principal components (eigenvectors)
        principal_components = pca.components_

        # Ensure right-handed coordinate system
        # Check if determinant is positive (right-handed)
        det = np.linalg.det(principal_components)
        if det < 0:
            # Flip the third component to ensure right-handedness
            principal_components[2] = -principal_components[2]

        # Transform points to PCA space using original component order
        pca_points = np.dot(points, principal_components.T)

        # Find bounds in PCA space
        min_bounds = np.min(pca_points, axis=0)
        max_bounds = np.max(pca_points, axis=0)

        # Compute unsorted dimensions (keep original PCA axis order)
        dimensions = max_bounds - min_bounds

        # Find bounding box center in PCA space
        # Since component is centered at origin, bbx_origin is just the
        # bounding box center in PCA space
        bbx_origin = (min_bounds + max_bounds) / 2.0

        return dimensions.tolist(), principal_components, bbx_origin.tolist()

    def minimum_bounding_rectangle(self, points):
        """
        Compute minimum bounding rectangle for 2D points.
        Returns rectangle corners and angle.
        """
        # Compute the convex hull of the points
        hull = ConvexHull(points)
        hull_points = points[hull.vertices]

        # Initialize variables to keep track of the best rectangle
        min_area = float('inf')
        best_rectangle = None
        best_angle = 0

        # Loop through each edge of the convex hull
        for i in range(len(hull_points)):
            # Determine the points forming the current edge
            p1 = hull_points[i]
            p2 = hull_points[(i + 1) % len(hull_points)]

            # Calculate edge vector
            edge_vec = p2 - p1

            # Rotate the points to align this edge with the x-axis
            angle = np.arctan2(edge_vec[1], edge_vec[0])
            cos_angle = np.cos(-angle)
            sin_angle = np.sin(-angle)
            rot_matrix = np.array([[cos_angle, -sin_angle],
                                   [sin_angle, cos_angle]])
            rotated_points = np.dot(points, rot_matrix.T)

            # Compute the min/max x/y in the rotated points
            min_x = np.min(rotated_points[:, 0])
            max_x = np.max(rotated_points[:, 0])
            min_y = np.min(rotated_points[:, 1])
            max_y = np.max(rotated_points[:, 1])

            # Calculate area of the bounding rectangle
            area = (max_x - min_x) * (max_y - min_y)

            if area < min_area:
                min_area = area
                best_angle = angle

                # Create the rectangle in the rotated space and then rotate it
                # back
                best_rectangle = np.array([
                    [min_x, min_y],
                    [max_x, min_y],
                    [max_x, max_y],
                    [min_x, max_y]
                ])

                inv_rot_matrix = np.array([
                    [cos_angle, sin_angle],
                    [-sin_angle, cos_angle]
                ])
                best_rectangle = np.dot(best_rectangle, inv_rot_matrix.T)

        return best_rectangle, best_angle

    def compute_obb_2d(self, points, height):
        """
        Compute object oriented bounding box for extrusions using the
        minimum bounding rectangle method to find optimal 2D orientation.
        Returns unsorted dimensions and bounding box origin.
        """
        # Extract only X and Y coordinates for 2D analysis
        points_2d = points[:, :2]

        # Use the minimum bounding rectangle method to find optimal orientation
        mbr, optimal_angle = self.minimum_bounding_rectangle(points_2d)

        # The optimal_angle is the angle of the edge vector that gives
        # minimum area. To align this edge with the x-axis, we need to
        # rotate by -optimal_angle. This matches the logic in
        # minimum_bounding_rectangle
        cos_angle = np.cos(-optimal_angle)
        sin_angle = np.sin(-optimal_angle)

        # Rotate points to the optimal orientation
        rot_matrix = np.array([
            [cos_angle, -sin_angle],
            [sin_angle, cos_angle]
        ])
        rotated_points = np.dot(points_2d, rot_matrix.T)

        # Compute dimensions in the rotated coordinate system
        min_x = np.min(rotated_points[:, 0])
        max_x = np.max(rotated_points[:, 0])
        min_y = np.min(rotated_points[:, 1])
        max_y = np.max(rotated_points[:, 1])

        x_dim = max_x - min_x
        y_dim = max_y - min_y

        # Find bounding box center in rotated 2D space
        bbx_center_2d = [(min_x + max_x) / 2.0, (min_y + max_y) / 2.0]

        # Find Z center (since component is centered, this should be near 0)
        min_z = np.min(points[:, 2])
        max_z = np.max(points[:, 2])
        z_center = (min_z + max_z) / 2.0

        # Since component is centered at origin, bbx_origin is the bounding
        # box center in rotated 2D space + Z center
        bbx_origin_2d = [bbx_center_2d[0], bbx_center_2d[1], z_center]

        # Ensure X is the longest dimension for consistency
        if x_dim >= y_dim:
            dimensions = [x_dim, y_dim, height]
            # PCA frame aligns with the optimal orientation
            principal_components = np.array([
                [cos_angle, -sin_angle, 0],  # X axis = long axis
                [sin_angle, cos_angle, 0],   # Y axis = short axis
                [0, 0, 1]                    # Z axis stays vertical
            ])
        else:
            # Swap dimensions - the longer dimension should be X
            dimensions = [y_dim, x_dim, height]
            # Rotate by 90 degrees to make Y the X axis
            cos_angle_90 = np.cos(-optimal_angle + np.pi / 2)
            sin_angle_90 = np.sin(-optimal_angle + np.pi / 2)
            principal_components = np.array([
                [cos_angle_90, -sin_angle_90, 0],  # X axis = long axis
                [sin_angle_90, cos_angle_90, 0],   # Y axis = short axis
                [0, 0, 1]                          # Z axis stays vertical
            ])

        return dimensions, principal_components, bbx_origin_2d

    def rhino_xform(self, transformation_matrix) -> Rhino.Geometry.Transform:
        """
        Convert numpy transformation matrix to Rhino Transform.
        """
        XForm = Rhino.Geometry.Transform.Identity
        XForm.M00 = transformation_matrix[0][0]
        XForm.M01 = transformation_matrix[0][1]
        XForm.M02 = transformation_matrix[0][2]
        XForm.M03 = transformation_matrix[0][3]
        XForm.M10 = transformation_matrix[1][0]
        XForm.M11 = transformation_matrix[1][1]
        XForm.M12 = transformation_matrix[1][2]
        XForm.M13 = transformation_matrix[1][3]
        XForm.M20 = transformation_matrix[2][0]
        XForm.M21 = transformation_matrix[2][1]
        XForm.M22 = transformation_matrix[2][2]
        XForm.M23 = transformation_matrix[2][3]
        return XForm

    def process_geometry(self, geometry: Rhino.Geometry.GeometryBase):
        """
        Process geometry to extract points and determine if 3D.
        Returns points array and boolean indicating if 3D.
        """
        compute_3d = False
        # HANDLE BREP
        if isinstance(geometry, Rhino.Geometry.Brep):
            points = np.array([[p.Location.X,
                                p.Location.Y,
                                p.Location.Z] for p in geometry.Vertices])
            compute_3d = True
        # HANDLE EXTRUSIONS
        elif isinstance(geometry, Rhino.Geometry.Extrusion):
            brep = geometry.ToBrep()
            points = np.array([[p.Location.X,
                                p.Location.Y,
                                p.Location.Z] for p in brep.Vertices])
            compute_3d = False
        # HANDLE MESH
        elif isinstance(geometry, Rhino.Geometry.Mesh):
            points = np.array([[p.X, p.Y, p.Z] for p in geometry.Vertices])
            compute_3d = True
        # IF NOT ONE OF THESE GEOMETRY TYPES
        else:
            raise RuntimeError('Geometry processing not implemented '
                               f'for geometry of type {type(geometry)}!')
        # return results
        return points, compute_3d

    def validate_uuid(self, uuid_to_test: str, version: int = 4) -> bool:
        """
        Check if uuid_to_test is a valid UUID.
        Returns True if uuid_to_test is a valid UUID, otherwise False.
        """
        try:
            uuid_obj = uuid.UUID(uuid_to_test, version=version)
        except ValueError:
            return False
        return str(uuid_obj) == uuid_to_test

    def get_pending_assets_root(self) -> str:
        """Root directory for staged identity mesh PLY files."""
        if platform.system() == 'Windows':
            base_path = os.path.expandvars('%APPDATA%')
            return os.path.join(
                base_path,
                'DDU_CSC',
                'pending_identity_assets'
            )
        base_path = os.path.expanduser('~')
        return os.path.join(
            base_path, 'Library', 'Application Support', 'DDU_CSC',
            'pending_identity_assets',
        )

    def get_identity_assets_dir(self, identity_id: str) -> str:
        return os.path.join(self.get_pending_assets_root(), identity_id)

    def get_mesh_primitive_dir(
            self,
            identity_id: str,
            primitive_index: int
    ) -> str:
        return os.path.join(
            self.get_identity_assets_dir(identity_id),
            'meshes',
            str(primitive_index),
        )

    def write_staging_manifest(self, identity_id: str, mesh_primitives: dict):
        """Write manifest.json for AddComponent upload handoff."""
        manifest = {
            'identity_id': identity_id,
            'coordinate_frame': 'rhino_z_up',
            'mesh_primitives': mesh_primitives,
        }
        assets_dir = self.get_identity_assets_dir(identity_id)
        os.makedirs(assets_dir, exist_ok=True)
        manifest_path = os.path.join(assets_dir, 'manifest.json')
        with open(manifest_path, 'w', encoding='utf-8') as handle:
            json.dump(manifest, handle, indent=2)

    def clear_pending_identity_assets_directory(self):
        """Clear all staged pending_identity_assets (not Session cache)."""
        try:
            assets_dir = self.get_pending_assets_root()
            if os.path.exists(assets_dir):
                import shutil
                shutil.rmtree(assets_dir, ignore_errors=True)
                os.makedirs(assets_dir, exist_ok=True)
                self._addRemark(
                    f'Cleared pending_identity_assets: {assets_dir}'
                )
                return True
            self._addRemark('pending_identity_assets does not exist yet')
            return True
        except Exception as e:
            self._addWarning(
                f'Failed to clear pending_identity_assets: {str(e)}'
            )
            return False

    def reduce_mesh(
        self, mesh: Rhino.Geometry.Mesh, target_face_count: int
    ) -> Rhino.Geometry.Mesh:
        """
        Reduce a mesh to a target face count using Rhino's mesh reduction.
        Returns the reduced mesh.
        """
        reduced_mesh = mesh.Duplicate()
        reduced_mesh.Reduce(target_face_count, True, 5, False, True)
        reduced_mesh.Faces.ConvertQuadsToTriangles()
        reduced_mesh.Compact()
        return reduced_mesh

    def _stage_mesh_ply_files(
            self,
            identity_id: str,
            primitive_index: int,
            detailed_mesh,
            reduced_mesh,
            default_rgb,
            mesh_primitive_threshold: int,
            mesh_reduced_threshold: int,
            mesh_reduced_target: int,
            mesh_primitive_target: int):
        """
        Reduce meshes if needed and write detailed.ply / reduced.ply for one
        primitive index. Returns (primitive_mesh, resolutions_on_disk).
        """
        if detailed_mesh is None:
            return None, []

        face_count = detailed_mesh.Faces.Count
        reduced = None
        primitive = detailed_mesh
        resolutions = []

        primitive_dir = self.get_mesh_primitive_dir(
            identity_id, primitive_index)
        detailed_path = os.path.join(primitive_dir, 'detailed.ply')
        reduced_path = os.path.join(primitive_dir, 'reduced.ply')

        if os.path.exists(detailed_path) or os.path.exists(reduced_path):
            self._addWarning(
                f'PLY files already exist for identity {identity_id} '
                f'primitive {primitive_index}; skipping overwrite.'
            )
            if face_count > mesh_reduced_threshold:
                primitive = self.reduce_mesh(
                    detailed_mesh, mesh_primitive_target)
            elif face_count > mesh_primitive_threshold:
                primitive = self.reduce_mesh(
                    detailed_mesh, mesh_primitive_target)
            return primitive, []

        save_detailed = face_count > mesh_primitive_target
        save_reduced = face_count > mesh_reduced_threshold

        if face_count > mesh_reduced_threshold:
            reduced = self.reduce_mesh(detailed_mesh, mesh_reduced_target)
            primitive = self.reduce_mesh(detailed_mesh, mesh_primitive_target)
        elif face_count > mesh_primitive_threshold:
            primitive = self.reduce_mesh(detailed_mesh, mesh_primitive_target)

        try:
            if save_detailed:
                self.save_rhino_mesh_as_ply_binary(
                    detailed_mesh, detailed_path, default_rgb)
                resolutions.append('detailed')
            if save_reduced and reduced is not None:
                self.save_rhino_mesh_as_ply_binary(
                    reduced, reduced_path, default_rgb)
                resolutions.append('reduced')
            if resolutions:
                self._addRemark(
                    f'Staged PLY for primitive {primitive_index}: '
                    f'{", ".join(resolutions)}'
                )
        except Exception as e:
            self._addWarning(f'Failed to stage PLY files: {str(e)}')
            resolutions = []

        return primitive, resolutions

    def process_mesh_geometry(
        self,
        geometry: Rhino.Geometry.Mesh,
        identity_id: str,
        default_rgb,
        mesh_primitive_threshold: int = 8000,
        mesh_reduced_threshold: int = 15000,
        mesh_reduced_target: int = 10000,
        mesh_primitive_target: int = 500,
    ) -> tuple:
        """
        Returns (original, reduced, primitive_mesh, mesh_primitives dict).
        """
        primitive_mesh, resolutions = self._stage_mesh_ply_files(
            identity_id,
            0,
            geometry,
            None,
            default_rgb,
            mesh_primitive_threshold,
            mesh_reduced_threshold,
            mesh_reduced_target,
            mesh_primitive_target,
        )
        mesh_primitives = {}
        if resolutions:
            mesh_primitives['0'] = resolutions
        reduced_mesh = None
        if geometry.Faces.Count > mesh_reduced_threshold:
            reduced_mesh = self.reduce_mesh(geometry, mesh_reduced_target)
        return geometry, reduced_mesh, primitive_mesh, mesh_primitives

    def process_multiple_meshes_geometry(
            self,
            meshes,
            identity_id,
            default_rgb,
            mesh_primitive_threshold: int = 8000,
            mesh_reduced_threshold: int = 15000,
            mesh_reduced_target: int = 10000,
            mesh_primitive_target: int = 500):
        """Returns (primitive_meshes, mesh_primitives dict)."""
        if not meshes:
            return [], {}

        primitive_meshes = []
        mesh_primitives = {}

        for index, mesh in enumerate(meshes):
            if mesh is None:
                primitive_meshes.append(None)
                continue
            primitive_mesh, resolutions = self._stage_mesh_ply_files(
                identity_id,
                index,
                mesh,
                None,
                default_rgb,
                mesh_primitive_threshold,
                mesh_reduced_threshold,
                mesh_reduced_target,
                mesh_primitive_target,
            )
            primitive_meshes.append(primitive_mesh)
            if resolutions:
                mesh_primitives[str(index)] = resolutions

        return primitive_meshes, mesh_primitives

    def compute_pca_for_multiple_meshes(self, meshes):
        """
        Compute PCA for multiple meshes as a whole assembly.
        Centers the assembly at origin before computing PCA.
        Returns dimensions, principal components, translation vector,
        and bbx_origin.
        """
        if not meshes or len(meshes) == 0:
            return None, None, None, None

        # Collect area-weighted samples from all meshes
        sample_chunks = []
        for mesh in meshes:
            if mesh is None:
                continue
            # sample_chunks.append(
            #     self.sample_points_area_weighted_from_mesh(mesh)
            # )
            sample_chunks.append(mesh.Vertices)

        if not sample_chunks:
            return None, None, None, None

        points_array = np.vstack(sample_chunks)

        # Center the assembly at origin (like single meshes)
        # Compute centroid of all points
        centroid = np.mean(points_array, axis=0)
        translation_vector = -centroid

        # Center the points
        centered_points = points_array + translation_vector

        # Compute PCA for the centered combined geometry
        dimensions, principal_components, bbx_origin = (
            self.compute_obb_3d(centered_points)
        )

        return dimensions, principal_components, translation_vector, bbx_origin

    def compute_pca_for_first_mesh_only(self, meshes):
        """
        Compute PCA for only the first mesh, but apply transformations to all
        meshes.
        Centers only the first mesh at origin before computing PCA.
        Returns dimensions, principal components, translation vector,
        and bbx_origin.
        """
        # Retrieve the first mesh
        mesh = meshes[0]
        # Use the same centering approach as single mesh case
        # Center the first mesh at origin using volume centroid
        (centered_mesh, translation_vector) = (
            self.center_geometry_at_origin(mesh)
        )
        # Area-weighted samples from the centered first mesh
        centered_points, _ = self.process_geometry(centered_mesh)
        dimensions, principal_components, bbx_origin = (
            self.compute_obb_3d(centered_points)
        )
        return dimensions, principal_components, translation_vector, bbx_origin

    def RunScript(self,
            ClearLocalStorage: bool,
            IdentityID: str,
            Name: str,
            Type: str,
            Material: str,
            Dataset: str,
            Complexity: int,
            Fragment: bool,
            Assembly: bool,
            Color: System.Drawing.Color,
            Location: Rhino.Geometry.Vector3d,
            Geometry: System.Collections.Generic.List[Rhino.Geometry.GeometryBase],
            MarkerPoints: System.Collections.Generic.List[Rhino.Geometry.Point3d],
            Condition,
            ManufacturedAt,
            ManufacturedPrecision,
            SalvageSource,
            SalvagedAt,
            ParentIdentity,
            Quantity,
            Notes):

        # MESH REDUCTION SETTINGS
        # If mesh has tc above this but below reduced threshold,
        # only the primitive version will be computed
        MESH_PRIMITIVE_THRESHOLD = 8000
        # If mesh has tc above this, reduced and primitive versions
        # will be created
        MESH_REDUCED_THRESHOLD = 15000
        # target tc for reduced mesh
        MESH_REDUCED_TARGET = 10000
        # target tc for primitive mesh
        MESH_PRIMITIVE_TARGET = 500

        # set up output trees and results tuple
        ComponentData = Grasshopper.DataTree[System.Object]()
        try:
            # Handle ClearLocalStorage input
            if ClearLocalStorage:
                self._addRemark(
                    'Clearing pending_identity_assets directory...'
                )
                if self.clear_pending_identity_assets_directory():
                    self.Component.Message = (
                        'Local storage cleared successfully'
                    )
                else:
                    self.Component.Message = 'Failed to clear local storage'
                return ComponentData

            # Initialize schema validation
            self._addRemark(
                'Initializing identity create payload '
                'with schema validation...'
            )

            if not IdentityID:
                msg = 'Input IdentityID failed to collect data!'
                self._addWarning(msg)
                return ComponentData
            elif not self.validate_uuid(IdentityID):
                msg = 'Input IdentityID is not a valid UUID! Aborting...'
                self._addError(msg)
                return ComponentData
            if not Name:
                msg = (
                    'Input Name failed to collect data. '
                    'Using auto-generated name!'
                )
                self._addRemark(msg)
                Name = ''
            if not Type:
                msg = 'Input Type failed to collect data!'
                self._addWarning(msg)
                return ComponentData
            if not Material:
                msg = 'Input Material failed to collect data!'
                self._addWarning(msg)
                return ComponentData
            if not Dataset:
                msg = 'Input Dataset failed to collect data!'
                self._addWarning(msg)
                return ComponentData
            if Complexity is None:
                msg = 'Input Complexity failed to collect data!'
                self._addWarning(msg)
                return ComponentData
            if (not isinstance(Complexity, int) or
                    Complexity < 0 or Complexity > 3):
                msg = 'Input Complexity must be an integer between 0 and 3!'
                self._addError(msg)
                return ComponentData

            # Set defaults for Fragment and Assembly if not provided
            if Fragment is None:
                Fragment = False
            if Assembly is None:
                Assembly = False

            # Handle Location parameter (X=latitude, Y=longitude, Z ignored)
            location_data = None
            if Location is not None:
                location_data = {
                    "lat": Location.X,
                    "lon": Location.Y
                }

            # ---------------------------------------------------------------
            # Provenance / lineage inputs (all optional). Validate here and
            # drop to None on invalid values with a warning, so the
            # component still creates (backend treats missing as null).
            # ---------------------------------------------------------------
            if Condition is not None:
                try:
                    Condition = int(Condition)
                except Exception:
                    self._addWarning(
                        'Input Condition must be an integer in '
                        '{0, 1, 2, 3}. Ignoring provided value: '
                        f'{Condition!r}.'
                    )
                    Condition = None
                else:
                    if Condition not in (0, 1, 2, 3):
                        self._addWarning(
                            'Input Condition must be in {0, 1, 2, 3}. '
                            f'Ignoring out-of-range value: {Condition}.'
                        )
                        Condition = None

            if ManufacturedAt is not None:
                ManufacturedAt = str(ManufacturedAt).strip()
                if ManufacturedAt == '':
                    ManufacturedAt = None

            if ManufacturedPrecision is not None:
                ManufacturedPrecision = str(ManufacturedPrecision).strip()
                if ManufacturedPrecision == '':
                    ManufacturedPrecision = None
                elif ManufacturedPrecision not in (
                    'exact', 'month', 'year', 'unknown'
                ):
                    self._addWarning(
                        'Input ManufacturedPrecision must be one of '
                        '"exact", "month", "year", "unknown". Ignoring '
                        f'provided value: {ManufacturedPrecision!r}.'
                    )
                    ManufacturedPrecision = None

            if SalvageSource is not None:
                SalvageSource = str(SalvageSource).strip()
                if SalvageSource == '':
                    SalvageSource = None

            if SalvagedAt is not None:
                SalvagedAt = str(SalvagedAt).strip()
                if SalvagedAt == '':
                    SalvagedAt = None

            if ParentIdentity is not None:
                ParentIdentity = str(ParentIdentity).strip()
                if ParentIdentity == '':
                    ParentIdentity = None
                elif not self.validate_uuid(ParentIdentity):
                    self._addWarning(
                        'Input ParentIdentity must be a valid UUID. '
                        f'Ignoring provided value: {ParentIdentity!r}.'
                    )
                    ParentIdentity = None

            if Notes is not None:
                Notes = str(Notes)
            if Quantity is not None:
                try:
                    Quantity = int(Quantity)
                except (TypeError, ValueError):
                    self._addWarning(
                        'Input Quantity must be an integer;'
                        f'ignoring {Quantity!r}'
                    )
                    Quantity = 1
                if Quantity < 1 or Quantity > 999_999:
                    self._addWarning(
                        'Input Quantity must be between 1 and 999999; using 1'
                    )
                    Quantity = 1

            if not Color:
                msg = ('Input Color failed to collect data. '
                       'Will use Grey as default Color.')
                self._addRemark(msg)
                print(msg)
                Color = System.Drawing.Color.FromArgb(255, 175, 175, 175)
            if not Geometry:
                msg = 'Input Geometry failed to collect data!'
                self._addWarning(msg)
                return ComponentData

            # TYPE FILTERING
            if not Geometry or len(Geometry) == 0:
                msg = 'Input Geometry is invalid!'
                self._addError(msg)
                return ComponentData

            # Check if single or multiple objects
            if len(Geometry) == 1:
                # Single object validation
                single_geometry = Geometry[0]
                if Type == 'rubble':
                    if not isinstance(single_geometry, Rhino.Geometry.Mesh):
                        msg = ('The "rubble" type expects a Mesh as '
                               'geometry input! Please ensure and try again.')
                        raise ValueError(msg)
                elif Type == 'panel':
                    if not isinstance(
                            single_geometry,
                            (Rhino.Geometry.Mesh, Rhino.Geometry.Extrusion)
                    ):
                        msg = (
                            'The "panel" type expects a Mesh or Extrusion '
                            'as geometry input! Please ensure and try '
                            'again.'
                        )
                        raise ValueError(msg)
            else:
                # Multiple objects - all must be meshes
                for i, geom in enumerate(Geometry):
                    if (geom is not None and
                            not isinstance(geom, Rhino.Geometry.Mesh)):
                        msg = (
                            f'The geometry input at index {i} is not a Mesh! '
                            'For multiple objects, all must be '
                            'Rhino.Geometry.Mesh objects.')
                        raise ValueError(msg)

            self.Component.Message = f'Processing {Type} identity...'
            default_rgb = (Color.R, Color.G, Color.B)

            # Process geometry to extract points and compute PCA
            if len(Geometry) == 1:
                # Handle single geometry (existing logic)
                single_geometry = Geometry[0]
                # Center geometry at world origin FIRST
                (centered_geometry, translation_vector) = (
                    self.center_geometry_at_origin(single_geometry)
                )
                centered_points, compute_3d = self.process_geometry(
                    centered_geometry
                )
                if compute_3d:
                    # centered_points = self.sample_points_for_pca_3d(
                    #     centered_geometry
                    # )
                    dimensions, principal_components, bbx_origin = (
                        self.compute_obb_3d(centered_points))
                else:
                    # 2D APPROACH, i.e. used for Extrusions
                    height = centered_geometry.PathStart.DistanceTo(
                        centered_geometry.PathEnd
                    )
                    dimensions, principal_components, bbx_origin = (
                        self.compute_obb_2d(
                            centered_points, height)
                    )
            else:
                # Handle multiple meshes - choose PCA computation based on
                # Assembly parameter
                if Assembly:
                    # Assembly=True: compute PCA for whole assembly
                    (dimensions, principal_components, translation_vector,
                     bbx_origin) = self.compute_pca_for_multiple_meshes(
                         Geometry)
                else:
                    # Assembly=False: compute PCA only for first mesh, but
                    # apply to all meshes
                    (dimensions, principal_components, translation_vector,
                     bbx_origin) = self.compute_pca_for_first_mesh_only(
                         Geometry)
                centered_geometry = None  # Not used for multiple meshes
                compute_3d = True  # Always 3D for multiple meshes

            schema = self.get_create_payload_schema()

            # Process marker points - apply same transformation as geometry
            marker_points_data = []
            if MarkerPoints and len(MarkerPoints) > 0:
                for point in MarkerPoints:
                    if point is not None:
                        # Apply the same translation vector used for
                        # centering geometry
                        transformed_point = [
                            point.X + translation_vector[0],
                            point.Y + translation_vector[1],
                            point.Z + translation_vector[2]
                        ]
                        marker_points_data.append(transformed_point)

            payload = self.build_create_payload(
                IdentityID, Name, Type, Material, Dataset, Complexity,
                Fragment, Assembly, Color, dimensions, location_data,
                principal_components, Condition, ManufacturedAt,
                ManufacturedPrecision, SalvageSource, SalvagedAt,
                ParentIdentity, Notes, Quantity,
            )
            payload['bbx_origin'] = bbx_origin
            if marker_points_data:
                payload['marker_points'] = marker_points_data

            mesh_primitives = {}

            # Process geometry input based on type
            if len(Geometry) == 1:
                # HANDLE SINGLE GEOMETRY
                single_geometry = Geometry[0]
                if isinstance(single_geometry, Rhino.Geometry.Mesh):
                    # Process single mesh
                    (_original_mesh,
                     _reduced_mesh,
                     primitive_mesh,
                     staged) = self.process_mesh_geometry(
                        centered_geometry,
                        IdentityID,
                        default_rgb,
                        mesh_primitive_threshold=MESH_PRIMITIVE_THRESHOLD,
                        mesh_reduced_threshold=MESH_REDUCED_THRESHOLD,
                        mesh_reduced_target=MESH_REDUCED_TARGET,
                        mesh_primitive_target=MESH_PRIMITIVE_TARGET,
                    )
                    mesh_primitives.update(staged)
                    payload['geometry'] = {
                        'meshes': [
                            self.mesh_to_inline_primitive(
                                primitive_mesh, default_rgb)
                        ],
                    }

                elif isinstance(single_geometry, Rhino.Geometry.Extrusion):
                    # Handle single extrusion (existing logic)
                    # Get the profile curve from the CENTERED geometry and
                    # convert to polyline
                    if centered_geometry.ProfileCount > 1:
                        raise RuntimeError(
                            'Extrusion has more than one profile!'
                        )
                    # Get first profile
                    profile_curve = centered_geometry.Profile3d(0, 0.0)
                    if profile_curve is None:
                        raise RuntimeError('Extrusion has no profile curve!')

                    # Convert profile to polyline
                    _tgpr, polyline = profile_curve.TryGetPolyline()
                    if _tgpr is False:
                        polyline = profile_curve.ToPolyline(0.01, 0.01, 0, 0)
                    if polyline is None:
                        raise RuntimeError(
                            'Failed to convert profile curve to polyline!'
                        )

                    # Get height
                    height = centered_geometry.PathStart.DistanceTo(
                        centered_geometry.PathEnd)

                    payload['geometry'] = {
                        'extrusions': [{
                            'profile': [[p.X, p.Y] for p in polyline],
                            'height': height,
                        }],
                    }
            else:
                # HANDLE MULTIPLE MESHES
                # Center all meshes using the translation
                # vector from PCA computation
                centered_meshes = []
                for mesh in Geometry:
                    if mesh is not None:
                        # Create a copy of the mesh
                        centered_mesh = mesh.Duplicate()
                        # Apply the translation to center the mesh
                        translation_xform = (
                            Rhino.Geometry.Transform.Translation(
                                translation_vector[0],
                                translation_vector[1],
                                translation_vector[2]
                            )
                        )
                        centered_mesh.Transform(translation_xform)
                        centered_meshes.append(centered_mesh)
                    else:
                        centered_meshes.append(None)

                primitive_meshes, staged = (
                    self.process_multiple_meshes_geometry(
                        centered_meshes,
                        IdentityID,
                        default_rgb,
                        mesh_primitive_threshold=MESH_PRIMITIVE_THRESHOLD,
                        mesh_reduced_threshold=MESH_REDUCED_THRESHOLD,
                        mesh_reduced_target=MESH_REDUCED_TARGET,
                        mesh_primitive_target=MESH_PRIMITIVE_TARGET,
                    )
                )
                mesh_primitives.update(staged)
                meshes_data = []
                for primitive_mesh in primitive_meshes:
                    if primitive_mesh is None:
                        continue
                    meshes_data.append(
                        self.mesh_to_inline_primitive(
                            primitive_mesh, default_rgb)
                    )
                payload['geometry'] = {'meshes': meshes_data}

            if mesh_primitives:
                self.write_staging_manifest(IdentityID, mesh_primitives)

            if not self.validate_create_payload(payload, schema):
                self._addWarning(
                    'Create payload validation failed, but continuing...'
                )

            ComponentData = json.dumps(payload)

            self.Component.Message = (
                f'Built create payload for identity {IdentityID}'
            )
            self._addRemark(f'Created {Type} identity payload {IdentityID}')

            # return output
            return ComponentData

        except ValueError as e:
            msg = f'Validation error: {str(e)}'
            self._addError(msg)

        except RuntimeError as e:
            msg = f'Runtime error: {str(e)}'
            self._addError(msg)

        except Exception as e:
            msg = f'Unexpected error: {str(e)}'
            self._addError(msg)
            raise e

        return ComponentData
# ---------- end createcomponentidentity ----------
componentdata = Data(createcomponentidentity)

# Step 3
# comments & notes: Finally, if CreateComponentIdentity runs without errors, we can submit the created Component to the Catalog!
# 
# Set the Toggle to True to execute the upload.
toggle = BooleanToggle(False)
componentdata_2 = Data(componentdata)
addcomponentidentity = AddComponentIdentity(ComponentData=componentdata_2, Run=toggle)  # -> AddedComponentData; inputs ComponentData: String, Run: Boolean
# ---------- addcomponentidentity: Python ----------
#! python3
# -*- coding: utf-8 -*-
# venv: DDU_CSC
print('ENV OK!')
# r: charset_normalizer
# r: requests

# PYTHON STANDARD LIBRARY IMPORTS ---------------------------------------------
import json  # NOQA
import os  # NOQA
import platform  # NOQA
import uuid  # NOQA

# THIRD PARTY LIBRARY IMPORTS -------------------------------------------------
import requests  # NOQA

# RHINO AND GH RELATED IMPORTS ------------------------------------------------
import System  # NOQA
import Grasshopper  # NOQA
import Rhino  # NOQA
import scriptcontext as sc  # NOQA

# GHENV COMPONENT SETTINGS ----------------------------------------------------
ghenv.Component.Name = 'AddComponentIdentity'  # NOQA
ghenv.Component.NickName = 'AddComponentIdentity'  # NOQA
ghenv.Component.Category = 'DDU_CSC'  # NOQA
ghenv.Component.SubCategory = '2 Catalog Interface'  # NOQA
ghenv.Component.Description = (  # NOQA
    'Creates a catalog identity and version-0 snapshot via POST /identities. '
    'Accepts CreateComponentRequest JSON from CreateComponentIdentity, '
    'uploads staged binary PLY mesh files from pending_identity_assets/, '
    'and optionally consumes a pending transmitted component ID.'
)


class CSC_AddComponentIdentity(Grasshopper.Kernel.GH_ScriptInstance):
    """
    Author: Max Benjamin Eschenbach
    License: MIT License
    Version: 260609
    """

    def __init__(self):
        """Initialize this component and set component parameters."""
        super().__init__()
        # initialize props
        self.Component = ghenv.Component  # NOQA
        self.InputParams = self.Component.Params.Input
        self.OutputParams = self.Component.Params.Output

    def _addRemark(self, msg: str = ''):
        """Add a remark message to the component."""
        rml = self.Component.RuntimeMessageLevel.Remark
        self.AddRuntimeMessage(rml, msg)

    def _addWarning(self, msg: str = ''):
        """Add a warning message to the component."""
        rml = self.Component.RuntimeMessageLevel.Warning
        self.AddRuntimeMessage(rml, msg)

    def _addError(self, msg: str = ''):
        """Add an error message to the component."""
        rml = self.Component.RuntimeMessageLevel.Error
        self.AddRuntimeMessage(rml, msg)

    def BeforeRunScript(self):
        """Perform some setup actions."""
        # Initialize input param descriptions
        self.InputParams[0].Description = (
            'CreateComponentRequest JSON from CreateComponentIdentity'
        )
        self.InputParams[1].Description = (
            'Toggle to execute the create operation'
        )
        # Initialize output param descriptions
        i = 0
        if self.OutputParams[0].Name == 'out':
            i += 1
        self.OutputParams[0+i].Description = (
            'Compose response JSON ({identity, snapshot}) '
            'from POST /identities'
        )

    def get_auth_core_from_sticky(self):
        """Get AuthCore instance from sticky storage."""
        auth_core = sc.sticky.get('CSC_AuthCore')
        if auth_core is None:
            msg = ('No authentication found. Please use CSC_Session component '
                   'first.')
            self._addError(msg)
            self.Component.Message = msg
            return None
        return auth_core

    def get_pending_assets_root(self) -> str:
        """
        Get the geometry folder path for a component.
        Returns the appropriate path based on the operating system.
        """
        if platform.system() == 'Windows':
            base_path = os.path.expandvars('%APPDATA%')
            return os.path.join(
                base_path, 'DDU_CSC', 'pending_identity_assets')
        base_path = os.path.expanduser('~')
        return os.path.join(
            base_path, 'Library', 'Application Support', 'DDU_CSC',
            'pending_identity_assets',
        )

    def get_identity_assets_dir(self, identity_id: str) -> str:
        return os.path.join(self.get_pending_assets_root(), identity_id)

    def load_staging_manifest(self, identity_id: str):
        manifest_path = os.path.join(
            self.get_identity_assets_dir(identity_id),
            'manifest.json',
        )
        if not os.path.isfile(manifest_path):
            return None
        try:
            with open(manifest_path, 'r', encoding='utf-8') as handle:
                return json.load(handle)
        except (OSError, json.JSONDecodeError) as exc:
            self._addWarning(f'Failed to read staging manifest: {exc}')
            return None

    def check_staged_ply_files(self, identity_id: str, manifest: dict) -> dict:
        assets_dir = self.get_identity_assets_dir(identity_id)
        mesh_primitives = manifest.get('mesh_primitives') or {}
        pending = []
        missing = []

        for index_str, resolutions in mesh_primitives.items():
            if not isinstance(resolutions, list):
                continue
            for resolution in resolutions:
                rel_path = os.path.join(
                    'meshes', str(index_str), f'{resolution}.ply')
                full_path = os.path.join(assets_dir, rel_path)
                entry = {
                    'primitive_index': str(index_str),
                    'resolution': resolution,
                    'path': full_path,
                }
                if os.path.isfile(full_path):
                    pending.append(entry)
                else:
                    missing.append(entry)

        return {
            'assets_dir': assets_dir,
            'pending': pending,
            'missing': missing,
        }

    def validate_create_payload(self, payload: dict) -> list:
        errors = []
        required_fields = [
            'type', 'material', 'dataset', 'complexity', 'fragment',
            'assembly', 'geometry', 'bbx', 'bbx_origin', 'iframe',
            'pca_frame',
        ]
        for field in required_fields:
            if field not in payload:
                errors.append(f'missing required field: {field}')

        identity_id = payload.get('_id', '')
        if not identity_id:
            errors.append('payload must contain a valid _id (identity UUID)')
        elif not self._validate_uuid(identity_id):
            errors.append('_id must be a valid UUID')

        if 'complexity' in payload and not isinstance(payload['complexity'], int):  # NOQA
            errors.append('complexity must be an integer')
        if 'fragment' in payload and not isinstance(payload['fragment'], bool):
            errors.append('fragment must be a boolean')
        if 'assembly' in payload and not isinstance(payload['assembly'], bool):
            errors.append('assembly must be a boolean')
        if 'dataset' in payload and not isinstance(payload['dataset'], str):
            errors.append('dataset must be a string')

        for axis_field in ('bbx', 'bbx_origin'):
            values = payload.get(axis_field)
            if values is not None:
                if (not isinstance(values, list) or len(values) != 3 or
                        not all(isinstance(x, (int, float)) for x in values)):
                    errors.append(f'{axis_field} must be a list of 3 numbers')

        for frame_field in ('iframe', 'pca_frame'):
            if frame_field in payload and not isinstance(
                    payload[frame_field], dict):
                errors.append(f'{frame_field} must be a frame object')

        color = payload.get('color')
        if color is not None:
            if (not isinstance(color, list) or len(color) != 3 or
                    not all(isinstance(x, int) and 0 <= x <= 255 for x in color)):  # NOQA
                errors.append('color must be a list of 3 integers (0-255)')

        geometry = payload.get('geometry') or {}
        if not geometry:
            errors.append('geometry must be present')
        elif not (
            geometry.get('meshes')
            or geometry.get('extrusions')
            or geometry.get('point_clouds')
        ):
            errors.append(
                'geometry must include meshes, extrusions, or point_clouds'
            )

        return errors

    def _validate_uuid(self, uuid_to_test: str, version: int = 4) -> bool:
        try:
            uuid_obj = uuid.UUID(uuid_to_test, version=version)
        except ValueError:
            return False
        return str(uuid_obj) == uuid_to_test

    def upload_staged_ply_files(
            self,
            auth_core,
            snapshot_id: str,
            identity_id: str,
            staged_files: list) -> bool:
        if not staged_files:
            return True

        upload_success = True
        headers = auth_core.auth_header()

        for entry in staged_files:
            primitive_index = entry['primitive_index']
            resolution = entry['resolution']
            file_path = entry['path']
            self.Component.Message = (
                f'Uploading PLY primitive {primitive_index} ({resolution})...'
            )
            self._addRemark(
                f'Uploading {os.path.basename(file_path)} for snapshot '
                f'{snapshot_id}'
            )

            try:
                with open(file_path, 'rb') as handle:
                    response = requests.put(
                        auth_core.base_url + (
                            f'/snapshots/{snapshot_id}/meshes/'
                            f'{primitive_index}/{resolution}'
                        ),
                        files={
                            'mesh_file': (
                                os.path.basename(file_path),
                                handle,
                                'application/octet-stream',
                            ),
                        },
                        headers=headers,
                        timeout=300,
                    )
            except requests.exceptions.Timeout:
                self._addWarning(
                    f'PLY upload timed out for primitive {primitive_index} '
                    f'({resolution}).'
                )
                upload_success = False
                continue
            except requests.exceptions.ConnectionError:
                self._addWarning(
                    f'Connection lost uploading primitive {primitive_index} '
                    f'({resolution}).'
                )
                upload_success = False
                continue
            except OSError as exc:
                self._addWarning(
                    f'Could not read staged PLY {file_path}: {exc}'
                )
                upload_success = False
                continue

            if response.status_code == 200:
                self._addRemark(
                    f'Uploaded {resolution} PLY '
                    f'for primitive {primitive_index}'
                )
            else:
                detail = response.text
                try:
                    detail = response.json().get('detail', detail)
                except (json.JSONDecodeError, AttributeError):
                    pass
                self._addWarning(
                    f'Failed to upload {resolution} PLY for primitive '
                    f'{primitive_index} ({response.status_code}): {detail}'
                )
                upload_success = False

        if upload_success:
            self._addRemark(
                f'All staged PLY files uploaded for identity {identity_id}'
            )
        return upload_success

    def _format_http_error(self, response) -> str:
        try:
            error_detail = response.json()
            if 'detail' in error_detail:
                detail = error_detail['detail']
                if isinstance(detail, list):
                    lines = []
                    for error in detail:
                        field = error.get('loc', ['unknown'])[-1]
                        message = error.get('msg', 'validation error')
                        lines.append(f'{field}: {message}')
                    return (
                        'Create payload validation '
                        'failed:\n' + '\n'.join(lines)
                    )
                return f'Create payload validation failed: {detail}'
            return f'Request failed: {error_detail}'
        except (json.JSONDecodeError, KeyError, AttributeError):
            return f'Request failed with status code {response.status_code}'

    def RunScript(self, ComponentData: str, Run: bool):
        # Set up output trees and results tuple
        AddedComponentData = Grasshopper.DataTree[System.Object]()

        # Get AuthCore instance from sticky storage
        auth_core = self.get_auth_core_from_sticky()
        if auth_core is None:
            return AddedComponentData

        # Check if authentication is valid
        if not auth_core.is_valid():
            msg = ('Authentication expired. Please use CSC_Session '
                   'component to refresh.')
            self._addError(msg)
            self.Component.Message = msg
            return AddedComponentData

        # Validate ComponentData input
        if not ComponentData:
            msg = 'Please provide CreateComponentRequest JSON to add.'
            self._addWarning(msg)
            self.Component.Message = msg
            return AddedComponentData

        # Validate JSON format
        try:
            payload = json.loads(ComponentData)
        except json.JSONDecodeError:
            msg = 'ComponentData must be valid JSON format.'
            self._addError(msg)
            self.Component.Message = msg
            return AddedComponentData

        validation_errors = self.validate_create_payload(payload)
        if validation_errors:
            msg = 'Create payload validation errors:\n' + '\n'.join(
                validation_errors)
            self._addError(msg)
            self.Component.Message = 'Validation failed'
            return AddedComponentData

        identity_id = payload['_id']
        geometry = payload.get('geometry') or {}
        has_meshes = bool(geometry.get('meshes'))

        manifest = self.load_staging_manifest(identity_id)
        staged_status = None
        if has_meshes and manifest:
            staged_status = self.check_staged_ply_files(identity_id, manifest)
            if staged_status['pending']:
                self._addRemark(
                    f'Found {len(staged_status["pending"])}'
                    ' staged PLY file(s) '
                    f'for identity {identity_id}'
                )
            if staged_status['missing']:
                missing_names = [
                    f'{item["primitive_index"]}/{item["resolution"]}.ply'
                    for item in staged_status['missing']
                ]
                self._addWarning(
                    'Manifest lists PLY files that are missing on disk: '
                    + ', '.join(missing_names)
                )
        elif has_meshes:
            self._addRemark(
                f'No staging manifest for identity {identity_id}; '
                'inline mesh primitives only'
            )

        if not Run:
            status_msg = f'Ready to create identity {identity_id}'
            if staged_status and staged_status['pending']:
                status_msg += (
                    f' with {len(staged_status["pending"])} '
                    'PLY file(s)'
                )
            status_msg += ' (toggle Run to execute)'
            self.Component.Message = status_msg
            return AddedComponentData

        try:
            self.Component.Message = 'Creating identity and snapshot...'

            response = auth_core.authorized_post(
                '/identities',
                json_body=payload,
            )

            if response.status_code == 201:
                compose = response.json()
                identity_doc = compose.get('identity') or {}
                snapshot_doc = compose.get('snapshot') or {}
                created_identity_id = identity_doc.get('_id', identity_id)
                snapshot_id = snapshot_doc.get('_id', '')

                # Create datatree path and add component to tree
                ghp = Grasshopper.Kernel.Data.GH_Path(0)
                AddedComponentData.Add(json.dumps(compose), ghp)

                self._addRemark(
                    f'Created identity {created_identity_id} '
                    f'(snapshot {snapshot_id})'
                )
                self.Component.Message = (
                    f'Created identity {created_identity_id}'
                )

                # Consume pending transmitted ID after successful DB insert.
                # This is intentionally non-fatal for AddComponent: if consume
                # fails, we keep the added component result and only warn.
                try:
                    consume_response = auth_core.authorized_post(
                        '/component_id_transmission/consume',
                        json_body={'identity_id': created_identity_id},
                    )
                    if consume_response.status_code == 200:
                        consume_payload = consume_response.json()
                        if consume_payload.get('consumed', False):
                            self._addRemark(
                                'Consumed pending transmitted ID after create.'
                            )
                        else:
                            self._addRemark(
                                'No matching transmitted ID to consume.'
                            )
                    else:
                        self._addWarning(
                            'Identity created, but transmitted ID consume '
                            f'failed ({consume_response.status_code}).'
                        )
                except Exception as exc:
                    self._addWarning(
                        'Identity created, but transmitted '
                        'ID consume errored: '
                        f'{str(exc)}'
                    )

                if (
                    snapshot_id
                    and staged_status
                    and staged_status['pending']
                ):
                    self.Component.Message = 'Uploading staged PLY files...'
                    upload_success = self.upload_staged_ply_files(
                        auth_core,
                        snapshot_id,
                        created_identity_id,
                        staged_status['pending'],
                    )
                    if upload_success:
                        self.Component.Message = (
                            f'Created identity {created_identity_id} with PLY'
                        )
                    else:
                        self._addWarning(
                            'Identity created but some PLY uploads failed'
                        )
                        self.Component.Message = (
                            f'Created identity {created_identity_id} '
                            '(PLY upload issues)'
                        )

                return AddedComponentData

            if response.status_code in (400, 422):
                msg = self._format_http_error(response)
                self._addError(msg)
                self.Component.Message = 'Create failed (validation)'
                return AddedComponentData

            if response.status_code == 401:
                msg = 'Authentication failed. Please sign in again.'
                self._addError(msg)
                self.Component.Message = msg
                return AddedComponentData

            if response.status_code == 403:
                msg = 'Access denied. Insufficient permissions.'
                self._addError(msg)
                self.Component.Message = msg
                return AddedComponentData

            if response.status_code == 409:
                msg = 'Identity already exists with this _id.'
                self._addWarning(msg)
                self.Component.Message = msg
                return AddedComponentData

            if response.status_code == 500:
                msg = 'Server error. Please try again later.'
                self._addWarning(msg)
                self.Component.Message = msg
                return AddedComponentData

            msg = self._format_http_error(response)
            self._addError(msg)
            self.Component.Message = msg
            return AddedComponentData

        except requests.exceptions.ConnectionError as exc:
            msg = 'Cannot connect to server. Please check your connection.'
            self._addError(msg + f'\nFull Error: {str(exc)}')
            self.Component.Message = msg

        except requests.exceptions.Timeout as exc:
            msg = 'Request timeout. Server may be slow.'
            self._addError(msg + f'\nFull Error: {str(exc)}')
            self.Component.Message = msg

        except requests.exceptions.RequestException as exc:
            msg = f'Request error: {str(exc)}'
            self._addError(msg)
            self.Component.Message = msg

        except Exception as exc:
            msg = f'Unexpected error: {str(exc)}'
            self._addError(msg)
            self.Component.Message = msg

        return AddedComponentData
# ---------- end addcomponentidentity ----------
componentdata_3 = Data(addcomponentidentity)
